# Grasshopper definition Function_by_C#.gh (Grasshopper 1.0.7)

# Replace multiple string
panel_3 = Panel("""ABC
BCA
BBCA""")
panel_4 = Panel("""A
B
C""")
# Note: [Above]
# Original "Replace Text" can only replace one string with another.
# [Below]
# Replace multiple string with others.
panel_5 = Panel("""1
2
3""")
panel_6 = Panel("""ABC
BCA
BBCA""")
panel_7 = Panel("""A
B
C""")
panel_8 = Panel("""1
2
3""")
select_text_from_rhino = Guid()
substring = Panel("""BCD
12
EF""")
# Find substring
c_script = CSharpScript(
    s1="ABCD123",
    s2=substring,
    TooltipDescriptionOverride="Find substring and return index, return -1 if substring is not found.",
    TooltipTextOverride="Find substring")  # -> i; inputs s1: String, s2: String
# ---------- c_script: C# usings ----------
using System.Text.RegularExpressions;
# ---------- c_script: C# ----------
    Match mc = Regex.Match(s1, s2);
    i = -1;
    if (mc.Success)
      i = mc.Index;
# ---------- end c_script ----------
# Text
# Get Rhino text
text = CSharpScript(T=select_text_from_rhino, TooltipDescriptionOverride="Get text from Rhino", TooltipTextOverride="Get Text")  # -> S, P; inputs T: Guid
# ---------- text: C# usings ----------
using Rhino.DocObjects;
# ---------- text: C# ----------
    var doc = RhinoDoc.ActiveDoc;
    
    TextObject textObject;
    textObject = (TextObject) doc.Objects.Find(T);

    Plane plane = textObject.TextGeometry.Plane;
    plane.Origin = textObject.Geometry.GetBoundingBox(false).Center;

    S = textObject.DisplayText;
    P = plane;
# ---------- end text ----------

# ---- group: Original replace
rep = ReplaceText(Text=panel_3, Find=panel_4, Replace=panel_5, RecursiveReplace=False)

# ---- group: Multiple replace
c_script_2 = CSharpScript(T=panel_6, F=panel_7, R=panel_8)  # -> S; inputs T: String, F: list of String, R: list of String
# ---------- c_script_2: C# ----------
    int n = F.Count;
    int i;
    string rs = T;
    for(i = 0;i < n;i++)
      rs = rs.Replace(F[i], R[i]);
    S = rs;
# ---------- end c_script_2 ----------

# ----
substring_index = Panel(c_script)
panel_9 = Panel(rep)
pln = Plane(text.P)
panel_10 = Panel(c_script_2)
string = Text(text.S)
# Note: The rectangle's size and position are measured in 'Pixels' and are unique to the viewport space instead 3D model space.
# [Example]
# Viewport size=(640,480)
# Rectangle location=(0,0); size=(320,240)
# The rectangle occupy the upper left section of the viewport, comprising one-quarter of the total viewport area.
# Draw Dot on rhino viewport
panel_12 = Panel("")
rectangle_height = Slider(40, range=0..100)
rectangle_height_2 = Slider(60, range=0..100)
rectangle_width = Slider(100, range=0..100)
# Display
# Draw 2d rectangle on rhino viewport
rectangle_screen_position = Panel("""100,200
300,200""")
panel_13 = Panel("""1000,1000,1000
20000,20000,200""")
thickness = Slider(2, range=0..10)
# Note: The dots' location are measured in Rhino document unit and are unique to the 3d model space instead of viewport space.
border_color = ColourSwatch(SwatchColor=RGB(255, 255, 255))
text_color = ColourSwatch(SwatchColor=RGB(255, 221, 0))
fill_color = ColourSwatch(SwatchColor=RGB(0, 0, 0))
border_color_2 = ColourSwatch(SwatchColor=RGB(0, 0, 0))
infill_color = ColourSwatch(SwatchColor=RGBA(106, 125, 62, 145))
infill_color_2 = ColourSwatch(SwatchColor=RGBA(62, 125, 119, 145))
rectangle = Rectangle(Plane=rectangle_screen_position, XSize=rectangle_width, YSize=[rectangle_height, rectangle_height_2], Radius=0)  # -> Rectangle, Length
c_script_3 = CSharpScript(
    L=panel_13,
    T="AAA",
    F="Arial",
    H=Slider(18, range=0..100),
    Cf=fill_color,
    Ct=text_color,
    Cb=border_color,
    TooltipDescriptionOverride="Draw 2D rectangle on active viewport",
    TooltipTextOverride="Draw rectangle")  # inputs L: Point3d, T: String, F: String, H: Int32, Cf: Color, Ct: Color, Cb: Color
# ---------- c_script_3: C# usings ----------
using System.Drawing;
# ---------- c_script_3: C# ----------
    // Clears the list in the first iteration.
    if (this.Iteration == 0)
      dot_list = new List<TextDots>();

    TextDots item = new TextDots
      {
        textdot = new TextDot(T, L),
        fill_color = Cf,
        text_color = Ct,
        border_color = Cb
        };
    item.textdot.FontHeight = H;
    item.textdot.FontFace = F;
    dot_list.Add(item);
# ---------- c_script_3: C# additional code ----------
  private struct TextDots
  {
    public TextDot textdot;
    public Color fill_color;
    public Color text_color;
    public Color border_color;
  }
  private List<TextDots> dot_list;


  public override void DrawViewportWires(IGH_PreviewArgs args)
  {
    // This display override only runs once.
    // So a list must be used to transfer all data here, if there are multiple rectangles.

    for (int i = 0; i < dot_list.Count; i++)
    {
      args.Display.DrawDot(dot_list[i].textdot, dot_list[i].fill_color, dot_list[i].text_color, dot_list[i].border_color);
    }
  }
# ---------- end c_script_3 ----------
c_script_4 = CSharpScript(
    R=rectangle.Rectangle,
    C1=border_color_2,
    C2=[infill_color_2, infill_color],
    T=thickness,
    TooltipDescriptionOverride="Draw 2D rectangle on active viewport",
    TooltipTextOverride="Draw rectangle")  # inputs R: Rectangle3d, C1: Color, C2: Color, T: Int32
# ---------- c_script_4: C# ----------
    // Clears the list in the first iteration.
    if (this.Iteration == 0)
      m_rectangle2d = new List<Rectangle2D>();

    Rectangle2D item = new Rectangle2D
      {
        rectangle2d = new Rectangle((int) R.Corner(0).X, (int) R.Corner(0).Y, (int) R.Width, (int) R.Height),
        strokecolor = C1,
        thickness = T,
        fillcolor = C2
        };

    m_rectangle2d.Add(item);
# ---------- c_script_4: C# additional code ----------
  private struct Rectangle2D
  {
    public Rectangle rectangle2d;
    public Color strokecolor;
    public int thickness;
    public Color fillcolor;
  }
  private List<Rectangle2D> m_rectangle2d;

  public override void DrawViewportWires(IGH_PreviewArgs args)
  {
    // This display override only runs once.
    // So a list must be used to transfer all data here, if there are multiple rectangles.

    for (int i = 0; i < m_rectangle2d.Count; i++)
    {
      args.Display.Draw2dRectangle(m_rectangle2d[i].rectangle2d, Color.Transparent, 0, m_rectangle2d[i].fillcolor);
      args.Display.Draw2dRectangle(m_rectangle2d[i].rectangle2d, m_rectangle2d[i].strokecolor, m_rectangle2d[i].thickness, Color.Transparent);
    }
  }
# ---------- end c_script_4 ----------
# Surface
panel_14 = Panel("")
list = ValueList({"ShrinkAllSides": 0, "DoNotShrinkWestSide": 1, "DoNotShrinkSouthSide": 2, "DoNotShrinkEastSide": 3, "DoNotShrinkNorthSide": 4}, selected="DoNotShrinkWestSide")
# ToEdge or not: If ToEdge is true, ShrinkSurfaceToEdge() is used, same as Rhino command "ShrinkTrimmedSrfToEdge", which shrinks the surface right to the trimming boundaries. Note, having the edges so close to the trimming boundaries can cause failure during commands that use the surface edges as input.
# If ToEdge is false, ShrinkFace() is used, same as Rhino command "ShrinkTrimmedSrf", in which case user can specify one of the four edges to skip shrinking.
toedge = BooleanToggle(False)
flipu = BooleanToggle(True)
flipv = BooleanToggle(False)
smooth = BooleanToggle(False)
# Flip surface U/V
srf = Surface(<surface referenced from the Rhino model>)
# Shrink surface
srf_2 = Surface(<surface referenced from the Rhino model>)
list_2 = ValueList({"North": 3, "East": 4, "West": 5, "South": 6}, selected="South")
# Swap surface U&V
srf_3 = Surface(<surface referenced from the Rhino model>)
srf_4 = Surface(<surface referenced from the Rhino model>)
# Extend surface
srf_5 = Surface(<surface referenced from the Rhino model>)
c_script_5 = CSharpScript(S0=srf, FlipU=flipu, FlipV=flipv)  # -> S; inputs S0: Surface, FlipU: Boolean, FlipV: Boolean
# ---------- c_script_5: C# ----------
    if (FlipU)
      S0.Reverse(0, true);
    if (FlipV)
      S0.Reverse(1, true);
    S = S0;
# ---------- end c_script_5 ----------
c_script_6 = CSharpScript(S0=srf_2, Sides=list, ToEdge=toedge)  # -> S; inputs S0: Brep, Sides: Int32, ToEdge: Boolean
# ---------- c_script_6: C# ----------
    if (ToEdge)
      S0.Faces[0].ShrinkSurfaceToEdge();
    else
      S0.Faces[0].ShrinkFace((BrepFace.ShrinkDisableSide) Sides);
    S = S0;
# ---------- end c_script_6 ----------
c_script_7 = CSharpScript(S=srf_3)  # -> T; inputs S: Surface
# ---------- c_script_7: C# ----------
    T = S.Transpose();
# ---------- end c_script_7 ----------

# ---- group: Simple shrink with ToEdge=false
c_script_8 = CSharpScript(S0=srf_4)  # -> S; inputs S0: Brep
# ---------- c_script_8: C# ----------
    S0.Faces[0].ShrinkFace(0);
    S = S0;
# ---------- end c_script_8 ----------

# ----
c_script_9 = CSharpScript(S=srf_5, Edge=list_2, Length=Slider(0.518, range=0..1), Smooth=smooth)  # -> E; inputs S: Surface, Edge: Int32, Length: Double, Smooth: Boolean
# ---------- c_script_9: C# ----------
    E = S.Extend((IsoStatus) Edge, Length, Smooth);
# ---------- end c_script_9 ----------
srf_6 = Surface(c_script_7)
srf_7 = Surface(c_script_8)
srf_8 = Surface(c_script_5)
srf_9 = Surface(c_script_6)
srf_10 = Surface(c_script_9)
# Mesh
panel_18 = Panel("")
# Create mesh from
# closed polyline
c_script_10 = CSharpScript()  # -> M; inputs P: Polyline
# ---------- c_script_10: C# ----------
    M = Mesh.CreateFromClosedPolyline(P);
# ---------- end c_script_10 ----------
# Object
panel_20 = Panel("")
geo = Geometry()
geo_2 = Geometry()
# Usage: [Input]
# Can be both geometry and GUID
# [Output]
# N=object name
# L=object layer name
# P=object layer full path
id = Guid()
geo_3 = Geometry()
# Get Rhino object attributes
geo_4 = Geometry()
id_2 = Guid()
# Bake object to layer
bake = Button()
panel_22 = Panel("""layer_1
layer_2""")
bake_2 = Button()
entwine = Entwine(Branch00=geo, Branch01=geo_2, FlattenInputs=True)
c_script_11 = CSharpScript(ID=[geo_4, id_2])  # -> N, L; inputs ID: Guid
# ---------- c_script_11: C# ----------
    Rhino.DocObjects.RhinoObject obj = doc.Objects.Find(ID);

    N = obj.Name;
    int i = obj.Attributes.LayerIndex;
    L = doc.Layers.FindIndex(i).Name;
# ---------- end c_script_11 ----------
c_script_12 = CSharpScript(ID=[geo_3, id])  # -> N, L, P; inputs ID: Guid
# ---------- c_script_12: C# ----------
    var doc = RhinoDoc.ActiveDoc;
    RhinoObject obj = doc.Objects.Find(ID);

    N = obj.Name;
    int i = obj.Attributes.LayerIndex;
    L = doc.Layers.FindIndex(i).Name;
    P = doc.Layers.FindIndex(i).FullPath;
# ---------- end c_script_12 ----------
geo_5 = Geometry()

# ---- group: To single layer
c_script_13 = CSharpScript(b=bake, G=geo_5, L="Defaults")  # -> out, A; inputs b: Boolean, G: GeometryBase, L: String
# ---------- c_script_13: C# usings ----------
using System.IO;
using System.Linq;
using System.Data;
using System.Drawing;
using System.Reflection;
using System.Windows.Forms;
using System.Xml;
using System.Xml.Linq;
using System.Runtime.InteropServices;

using Rhino.DocObjects;
using Rhino.Collections;
using GH_IO;
using GH_IO.Serialization;
# ---------- c_script_13: C# ----------
    if(b)
    {
      ObjectAttributes oa = new ObjectAttributes();
      oa.LayerIndex = doc.Layers.FindName(L).Index;
      doc.Objects.Add(G, oa);
    }
# ---------- end c_script_13 ----------

# ---- group: To multiple layers
c_script_14 = CSharpScript(b=bake_2, G=entwine, L=graft(panel_22))  # -> out, A; inputs b: Boolean, G: GeometryBase, L: String; same code as c_script_13

# ----
# Layer
panel_23 = Panel("")
c_script_15 = CSharpScript()  # -> ID; inputs N: String, P: String
# ---------- c_script_15: C# ----------
    ObjectEnumeratorSettings st = new ObjectEnumeratorSettings();
    int i;
    if (P != null)
      i = doc.Layers.FindByFullPath(P, 0);
    else
      i = doc.Layers.FindName(N).Index;
    st.LayerIndexFilter = i;
    st.HiddenObjects = true;
    st.LockedObjects = true;
    IEnumerable<RhinoObject> goolist = doc.Objects.GetObjectList(st);
    List<Guid> idlist = new List<Guid>();
    foreach (RhinoObject item in goolist)
    {
      idlist.Add(item.Id);
    }
    ID = idlist;
# ---------- end c_script_15 ----------
c_script_16 = CSharpScript()  # -> N, P; inputs L: String
# ---------- c_script_16: C# usings ----------
using Microsoft.VisualBasic;
using Microsoft.VisualBasic.CompilerServices;
# ---------- c_script_16: C# ----------
    int n = doc.Layers.Count;
    int i;
    string layerpath;

    List<string> namelist = new List<string>();
    List<string> pathlist = new List<string>();

    List<bool> blist = new List<bool>();
    for (i = 0;i < n;i++)
      if (doc.Layers[i].IsValid)
      {
        layerpath = doc.Layers[i].FullPath;
        if (LikeOperator.LikeString(layerpath, L, CompareMethod.Text))
        {
          pathlist.Add(layerpath);
          namelist.Add(doc.Layers[i].Name);
        }

      }
    P = pathlist;
    N = namelist;
# ---------- end c_script_16 ----------
# Others
panel_24 = Panel("")
# Unload grasshopper
# Usage 1: Sometimes GH lost its focus, combination key with "Ctrl" and single key like "Delete" signal always come to Rhino. Use this component to reload GH without restarting Rhino.
# Usage 2: For plugin developer who wants to reload GHA file without restarting Rhino.
# 
# 1: In GH preference set your plugin load mechanism to "copy to memory", restart Rhino to activate the new mechanism.
# 2: In Visual Studio build the GHA file.
# 3: Use this component to unload GH without restarting Rhino. It is recommended to delete boolean input and make this component a custom object in toolbar. In this way everytime the component is put on canvas through toolbar drag or F4 search, GH will be unloaded instantly. Note: If there are C# component in current GH file, a warning may pop out.
# 4: Run grasshopper command again in Rhino.
unload_gh = Button()
c_script_17 = CSharpScript(b=unload_gh, TooltipDescriptionOverride="Unload grasshopper while keep Rhino alive", TooltipTextOverride="Unload GH")  # inputs b: Boolean
# ---------- c_script_17: C# ----------
    if(b)
      Grasshopper.Instances.UnloadAllObjects();
# ---------- end c_script_17 ----------
